# Dynamo graph Remove_Revision_In_Sheet.dyn (Dynamo 2.6.1.8786)
# packages: archi-lab.net 2022.212.2821

categories = Categories("OST_Sheets")
all_elements_of_category = ElementsOfCategory(Category=categories)
select_revision = RevitRevisions("Seq. 1 - CONTAINMENT")
boolean = BoolSelector(true)
remove_revision_from_sheet = Custom[Remove Revision from Sheet](sheet=all_elements_of_category, revision=select_revision, runIt=boolean)  # package archi-lab.net; This node will remove specified Revisions from a sheet.
